# Grasshopper definition request.gh (Grasshopper 1.0.8)
# plug-ins: RhinoCodePluginGH, Assertive Possum, Swiftlet

panel = Panel("""{
  "hello" : "world"
}""")
panel_2 = Panel("""{
  "hello" : "world"
}""")
txtba = TextToByteArray(Text="Yay!", Encoding="UTF8")
curl = CreateURL(Scheme="http", Host="localhost", Port=Slider(5000, range=0..10000), Route="example/route")
curl_2 = CreateURL(Scheme="http", Host="localhost", Port=Slider(5000, range=0..10000), Route="/example/route")
ctb = CreateTextBody(
    Content=panel,
    IsHtmlChecked=False,
    IsJavascriptChecked=False,
    IsJsonChecked=True,
    IsTextChecked=False,
    IsXmlChecked=False)
ctb_2 = CreateTextBody(
    Content="Hello World",
    IsHtmlChecked=False,
    IsJavascriptChecked=False,
    IsJsonChecked=False,
    IsTextChecked=True,
    IsXmlChecked=False)
ctb_3 = CreateTextBody(
    Content="console.log(\"Hello World\");",
    IsHtmlChecked=False,
    IsJavascriptChecked=True,
    IsJsonChecked=False,
    IsTextChecked=False,
    IsXmlChecked=False)
ctb_4 = CreateTextBody(
    Content="<p>Hello World</p>",
    IsHtmlChecked=True,
    IsJavascriptChecked=False,
    IsJsonChecked=False,
    IsTextChecked=False,
    IsXmlChecked=False)
ctb_5 = CreateTextBody(
    Content="<item>Hello World</item>",
    IsHtmlChecked=False,
    IsJavascriptChecked=False,
    IsJsonChecked=False,
    IsTextChecked=False,
    IsXmlChecked=True)
ctbc = CreateTextBodyCustom(Content="1,2,3,4,5", ContentType="text/csv")
cbab = CreateByteArrayBody(Content="1,2,3,4,5", ContentType="text/csv")
cmfby = CreateMultipartFieldBytes(Name="my-file", Bytes=txtba, FileName="my-file.txt", ContentType="text/plain")
cmft = CreateMultipartFieldText(Name="hello-world", Text=panel_2, ContentType="application/json")
url = Panel("http://localhost:5000/example/route")
panel_3 = Panel(ctb)
panel_4 = Panel(ctb_2)
panel_5 = Panel(ctb_3)
panel_6 = Panel(ctb_4)
panel_7 = Panel(ctb_5)
panel_8 = Panel(ctbc)
panel_9 = Panel(cbab)
concat = Concatenate(FragmentA=curl, FragmentB="?param_1=yolo&param_2=yay")
aeq = AssertEqual(Name="create-url\url-no-leading-slash", Actual=curl, Expected=url, Tolerance=1e-06)
aeq_2 = AssertEqual(Name="create-url\url-no-leading-slash", Actual=curl_2, Expected=url, Tolerance=1e-06)
annl = AssertNotNull(Name="create-multipart-field-bytes\request-body-is-not-null", Value=cmfby)
annl_2 = AssertNotNull(Name="create-multipart-field-text\request-body-is-not-null", Value=cmft)
aeq_3 = AssertEqual(
    Name="create-text-body\json\request-body-to-string",
    Actual=panel_3,
    Expected="REQUEST BODY [ application/json ]",
    Tolerance=1e-06)
aeq_4 = AssertEqual(
    Name="create-text-body\text\request-body-to-string",
    Actual=panel_4,
    Expected="REQUEST BODY [ text/plain ]",
    Tolerance=1e-06)
aeq_5 = AssertEqual(
    Name="create-text-body\javascript\request-body-to-string",
    Actual=panel_5,
    Expected="REQUEST BODY [ text/javascript ]",
    Tolerance=1e-06)
aeq_6 = AssertEqual(
    Name="create-text-body\html\request-body-to-string",
    Actual=panel_6,
    Expected="REQUEST BODY [ text/html ]",
    Tolerance=1e-06)
aeq_7 = AssertEqual(
    Name="create-text-body\xml\request-body-to-string",
    Actual=panel_7,
    Expected="REQUEST BODY [ application/xml ]",
    Tolerance=1e-06)
aeq_8 = AssertEqual(
    Name="create-text-body-custom\csv\request-body-to-string",
    Actual=panel_8,
    Expected="REQUEST BODY [ text/csv ]",
    Tolerance=1e-06)
aeq_9 = AssertEqual(
    Name="create-byte-array-body\csv\request-body-to-string",
    Actual=panel_9,
    Expected="REQUEST BODY [ text/csv ]",
    Tolerance=1e-06)
test_result_to_json = TestResultToJSON(Result=aeq)
test_result_to_json_2 = TestResultToJSON(Result=aeq_2)
test_result_to_json_3 = TestResultToJSON(Result=annl)
test_result_to_json_4 = TestResultToJSON(Result=annl_2)
test_result_to_json_5 = TestResultToJSON(Result=aeq_3)
test_result_to_json_6 = TestResultToJSON(Result=aeq_4)
test_result_to_json_7 = TestResultToJSON(Result=aeq_5)
test_result_to_json_8 = TestResultToJSON(Result=aeq_6)
test_result_to_json_9 = TestResultToJSON(Result=aeq_7)
test_result_to_json_10 = TestResultToJSON(Result=aeq_8)
test_result_to_json_11 = TestResultToJSON(Result=aeq_9)
merge = Merge(Data1=cmft, Data2=cmfby)
context_print = ContextPrint(CreateUrlUrlNoLeadingSlash=test_result_to_json)
context_print_2 = ContextPrint(CreateUrlUrlNoLeadingSlash=test_result_to_json_2)
context_print_3 = ContextPrint(CreateMultipartFieldTextRequestBodyIsNotNull=test_result_to_json_4)
context_print_4 = ContextPrint(CreateMultipartFieldBytesRequestBodyIsNotNull=test_result_to_json_3)
db = DeconstructBody(Body=ctb)  # -> ContentType, Text, Bytes
context_print_5 = ContextPrint(CreateTextBodyJsonRequestBodyToString=test_result_to_json_5)
db_2 = DeconstructBody(Body=ctb_2)  # -> ContentType, Text, Bytes
context_print_6 = ContextPrint(CreateTextBodyTextRequestBodyToString=test_result_to_json_6)
db_3 = DeconstructBody(Body=ctb_3)  # -> ContentType, Text, Bytes
context_print_7 = ContextPrint(CreateTextBodyJavascriptRequestBodyToString=test_result_to_json_7)
db_4 = DeconstructBody(Body=ctb_4)  # -> ContentType, Text, Bytes
context_print_8 = ContextPrint(CreateTextBodyHtmlRequestBodyToString=test_result_to_json_8)
db_5 = DeconstructBody(Body=ctb_5)  # -> ContentType, Text, Bytes
context_print_9 = ContextPrint(CreateTextBodyXmlRequestBodyToString=test_result_to_json_9)
db_6 = DeconstructBody(Body=ctbc)  # -> ContentType, Text, Bytes
context_print_10 = ContextPrint(CreateTextBodyCustomCsvRequestBodyToString=test_result_to_json_10)
db_7 = DeconstructBody(Body=cbab)  # -> ContentType, Text, Bytes
context_print_11 = ContextPrint(CreateByteArrayBodyCsvRequestBodyToString=test_result_to_json_11)
cmfb = CreateMultipartFormBody(Fields=merge)
durl = DeconstructURL(URL=concat)  # -> Base, Scheme, Host, Route, Params
panel_10 = Panel(durl.Base)
panel_11 = Panel(cmfb)
panel_12 = Panel("REQUEST BODY [ multipart/form-data; boundary=\"b9c7a5a8-1ee4-4585-b321-02200beb0be2\" ]")
db_8 = DeconstructBody(Body=cmfb)  # -> ContentType, Text, Bytes
panel_13 = Panel("""{
  "hello" : "world"
}""")
panel_14 = Panel(durl.Route)
panel_15 = Panel(db.Bytes)
panel_16 = Panel(db_2.Bytes)
panel_17 = Panel(db_3.Bytes)
panel_18 = Panel(db_4.Bytes)
panel_19 = Panel(db_5.Bytes)
panel_20 = Panel(db_6.Bytes)
panel_21 = Panel(db_7.Bytes)
panel_22 = Panel(durl.Scheme)
panel_23 = Panel(durl.Host)
py3 = Python3Script()  # -> a; unedited script template
acnt = AssertContains()
item = ListItem(List=durl.Params, Index=0, Wrap=True)  # -> Item, Item1
aeq_10 = AssertEqual(Name="deconstruct-url\base-url", Actual=panel_10, Expected="http://localhost:5000/example/route", Tolerance=1e-06)
alen = AssertListLength(Name="deconstruct-url\params-list-length", List=durl.Params, Length="2")
aeq_11 = AssertEqual(Name="deconstruct-url\scheme", Actual=panel_22, Expected="http", Tolerance=1e-06)
aeq_12 = AssertEqual(Name="deconstruct-url\localhost", Actual=panel_23, Expected="localhost", Tolerance=1e-06)
aeq_13 = AssertEqual(Name="deconstruct-url\route", Actual=panel_14, Expected="/example/route", Tolerance=1e-06)
aeq_14 = AssertEqual(Name="create-text-body\json\content-type", Actual=db.ContentType, Expected="application/json", Tolerance=1e-06)
aeq_15 = AssertEqual(Name="create-text-body\json\text", Actual=db.Text, Expected=panel_13, Tolerance=1e-06)
aeq_16 = AssertEqual(Name="create-text-body\json\byte-array", Actual=panel_15, Expected="BYTE ARRAY [ 25 ]", Tolerance=1e-06)
aeq_17 = AssertEqual(Name="create-text-body\text\content-type", Actual=db_2.ContentType, Expected="text/plain", Tolerance=1e-06)
aeq_18 = AssertEqual(Name="create-text-body\text\text", Actual=db_2.Text, Expected="Hello World", Tolerance=1e-06)
aeq_19 = AssertEqual(Name="create-text-body\text\byte-array", Actual=panel_16, Expected="BYTE ARRAY [ 11 ]", Tolerance=1e-06)
aeq_20 = AssertEqual(Name="create-text-body\javascript\content-type", Actual=db_3.ContentType, Expected="text/javascript", Tolerance=1e-06)
aeq_21 = AssertEqual(Name="create-text-body\javascript\text", Actual=db_3.Text, Expected="console.log(\"Hello World\");", Tolerance=1e-06)
aeq_22 = AssertEqual(Name="create-text-body\javascript\byte-array", Actual=panel_17, Expected="BYTE ARRAY [ 27 ]", Tolerance=1e-06)
aeq_23 = AssertEqual(Name="create-text-body\javascript\content-type", Actual=db_4.ContentType, Expected="text/javascript", Tolerance=1e-06)
aeq_24 = AssertEqual(Name="create-text-body\javascript\text", Actual=db_4.Text, Expected="console.log(\"Hello World\");", Tolerance=1e-06)
aeq_25 = AssertEqual(Name="create-text-body\javascript\byte-array", Actual=panel_18, Expected="BYTE ARRAY [ 27 ]", Tolerance=1e-06)
aeq_26 = AssertEqual(Name="create-text-body\javascript\content-type", Actual=db_5.ContentType, Expected="text/javascript", Tolerance=1e-06)
aeq_27 = AssertEqual(Name="create-text-body\javascript\text", Actual=db_5.Text, Expected="console.log(\"Hello World\");", Tolerance=1e-06)
aeq_28 = AssertEqual(Name="create-text-body\javascript\byte-array", Actual=panel_19, Expected="BYTE ARRAY [ 27 ]", Tolerance=1e-06)
aeq_29 = AssertEqual(Name="create-text-body\csv\content-type", Actual=db_6.ContentType, Expected="text/csv", Tolerance=1e-06)
aeq_30 = AssertEqual(Name="create-text-body\csv\text", Actual=db_6.Text, Expected="1,2,3,4,5", Tolerance=1e-06)
aeq_31 = AssertEqual(Name="create-text-body\csv\byte-array", Actual=panel_20, Expected="BYTE ARRAY [ 9 ]", Tolerance=1e-06)
aeq_32 = AssertEqual(Name="create-byte-array-body\csv\content-type", Actual=db_7.ContentType, Expected="text/csv", Tolerance=1e-06)
aeq_33 = AssertEqual(Name="create-byte-array-body\csv\text", Actual=db_7.Text, Expected="1,2,3,4,5", Tolerance=1e-06)
aeq_34 = AssertEqual(Name="create-byte-array-body\csv\byte-array", Actual=panel_21, Expected="BYTE ARRAY [ 9 ]", Tolerance=1e-06)
test_result_to_json_12 = TestResultToJSON(Result=aeq_10)
test_result_to_json_13 = TestResultToJSON(Result=aeq_11)
test_result_to_json_14 = TestResultToJSON(Result=aeq_12)
test_result_to_json_15 = TestResultToJSON(Result=aeq_13)
test_result_to_json_16 = TestResultToJSON(Result=alen)
annl_3 = AssertNotNull(Name="deconstruct-url\params\first-param-not-null", Value=item.Item)
annl_4 = AssertNotNull(Name="deconstruct-url\params\second-param-not-null", Value=item.Item1)
test_result_to_json_17 = TestResultToJSON(Result=aeq_14)
test_result_to_json_18 = TestResultToJSON(Result=aeq_15)
test_result_to_json_19 = TestResultToJSON(Result=aeq_16)
test_result_to_json_20 = TestResultToJSON(Result=aeq_17)
test_result_to_json_21 = TestResultToJSON(Result=aeq_18)
test_result_to_json_22 = TestResultToJSON(Result=aeq_19)
test_result_to_json_23 = TestResultToJSON(Result=aeq_20)
test_result_to_json_24 = TestResultToJSON(Result=aeq_21)
test_result_to_json_25 = TestResultToJSON(Result=aeq_22)
test_result_to_json_26 = TestResultToJSON(Result=aeq_23)
test_result_to_json_27 = TestResultToJSON(Result=aeq_24)
test_result_to_json_28 = TestResultToJSON(Result=aeq_25)
test_result_to_json_29 = TestResultToJSON(Result=aeq_26)
test_result_to_json_30 = TestResultToJSON(Result=aeq_27)
test_result_to_json_31 = TestResultToJSON(Result=aeq_28)
test_result_to_json_32 = TestResultToJSON(Result=aeq_29)
test_result_to_json_33 = TestResultToJSON(Result=aeq_30)
test_result_to_json_34 = TestResultToJSON(Result=aeq_31)
test_result_to_json_35 = TestResultToJSON(Result=aeq_32)
test_result_to_json_36 = TestResultToJSON(Result=aeq_33)
test_result_to_json_37 = TestResultToJSON(Result=aeq_34)
panel_24 = Panel(db_8.Text)
context_print_12 = ContextPrint(DeconstructUrlBaseUrl=test_result_to_json_12)
context_print_13 = ContextPrint(DeconstructUrlScheme=test_result_to_json_13)
context_print_14 = ContextPrint(DeconstructUrlLocalhost=test_result_to_json_14)
context_print_15 = ContextPrint(DeconstructUrlRoute=test_result_to_json_15)
context_print_16 = ContextPrint(DeconstructUrlParamsListLength=test_result_to_json_16)
context_print_17 = ContextPrint(CreateTextBodyJsonContentType=test_result_to_json_17)
context_print_18 = ContextPrint(CreateTextBodyJsonText=test_result_to_json_18)
context_print_19 = ContextPrint(CreateTextBodyJsonByteArray=test_result_to_json_19)
context_print_20 = ContextPrint(CreateTextBodyJsonContentType=test_result_to_json_20)
context_print_21 = ContextPrint(CreateTextBodyJsonText=test_result_to_json_21)
context_print_22 = ContextPrint(CreateTextBodyJsonByteArray=test_result_to_json_22)
context_print_23 = ContextPrint(CreateTextBodyJavascriptContentType=test_result_to_json_23)
context_print_24 = ContextPrint(CreateTextBodyJavascriptText=test_result_to_json_24)
context_print_25 = ContextPrint(CreateTextBodyJavascriptByteArray=test_result_to_json_25)
context_print_26 = ContextPrint(CreateTextBodyJavascriptContentType=test_result_to_json_26)
context_print_27 = ContextPrint(CreateTextBodyJavascriptText=test_result_to_json_27)
context_print_28 = ContextPrint(CreateTextBodyJavascriptByteArray=test_result_to_json_28)
context_print_29 = ContextPrint(CreateTextBodyJavascriptContentType=test_result_to_json_29)
context_print_30 = ContextPrint(CreateTextBodyJavascriptText=test_result_to_json_30)
context_print_31 = ContextPrint(CreateTextBodyJavascriptByteArray=test_result_to_json_31)
context_print_32 = ContextPrint(CreateTextBodyCsvContentType=test_result_to_json_32)
context_print_33 = ContextPrint(CreateTextBodyCsvText=test_result_to_json_33)
context_print_34 = ContextPrint(CreateTextBodyCsvByteArray=test_result_to_json_34)
context_print_35 = ContextPrint(CreateByteArrayBodyCsvContentType=test_result_to_json_35)
context_print_36 = ContextPrint(CreateByteArrayBodyCsvText=test_result_to_json_36)
context_print_37 = ContextPrint(CreateByteArrayBodyCsvByteArray=test_result_to_json_37)
test_result_to_json_38 = TestResultToJSON(Result=annl_3)
test_result_to_json_39 = TestResultToJSON(Result=annl_4)
aeq_35 = AssertEqual(Name="create-multipart-form-body\request-body-to-string", Actual=panel_11, Expected=panel_12, Tolerance=1e-06)
context_print_38 = ContextPrint(DeconstructUrlParamsSecondParamNotNull=test_result_to_json_39)
context_print_39 = ContextPrint(DeconstructUrlParamsFirstParamNotNull=test_result_to_json_38)
test_result_to_json_40 = TestResultToJSON(Result=aeq_35)
context_print_40 = ContextPrint(CreateMultipartFormBodyRequestBodyToString=test_result_to_json_40)
